# Grasshopper definition Trekkekum.gh (Grasshopper 1.0.8)
# plug-ins: Electronova_test

file_path_excel_file_right_click_and_set = Text("..\..\..\Vedlegg\Trekkekum.xlsx")  # "File path excel file (Right click and \"Set Text\" to alter file path)"
hoveddel_height = Slider(800, range=0..1000)
number_slider = Slider(140, range=0..500)
choose_excel_row = Slider(2, range=0..4)
slant_height = Slider(100, range=0..1000)
toppramme_height = Slider(0, range=0..100)
bunnramme_height = Slider(100, range=0..100)
addition = Addition(A=hoveddel_height, B=bunnramme_height)
toppramme = Toppramme(
    Width=1200,
    Height=toppramme_height,
    Length=1000,
    WallThickness=number_slider,
    BunnrammeAndHoveddelOffset=addition,
    SlantHeight=slant_height,
    FilePath=file_path_excel_file_right_click_and_set,
    NumberInExcelFile=choose_excel_row)
hoveddel = Hoveddel(
    Width=1200,
    Height=hoveddel_height,
    Length=1000,
    WallThickness=number_slider,
    BunnrammeOffset=bunnramme_height,
    FilePath=file_path_excel_file_right_click_and_set,
    NumberInExcelFile=choose_excel_row)
bunnramme = Bunnramme(
    Width=1200,
    Height=bunnramme_height,
    Length=1000,
    WallThickness=number_slider,
    FilePath=file_path_excel_file_right_click_and_set,
    NumberInExcelFile=choose_excel_row)
deconstruct_brep = DeconstructBrep(Brep=toppramme)  # -> Faces, Edges, Vertices
find_correct_surface = Slider(3, range=0..20)
unit_x = UnitX(Factor=number_slider)
list_item = ListItem(List=deconstruct_brep.Faces, Index=find_correct_surface, Wrap=True)
extrude = Extrude(Base=list_item, Direction=unit_x)
model_material = ModelMaterial("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")
custom_preview = CustomPreview(Geometry=[bunnramme, hoveddel, toppramme, extrude], Material=model_material)
